# Dynamo graph GHTImageRegistrationDynamoPrototype.dyn (Dynamo 2.12.1.8246)
# packages: archi-lab.net 2022.212.3222, Morpheus 2019.8.26

file_path = Filename("..\Experiment\Revit simulation\Test\UAV image GPS.xlsx")
file_from_path = FileObject(path=file_path)
code_block = CodeBlock { "Inspection"; }
importExcel = Data.ImportExcel(file=file_from_path, sheetName=code_block)
code_block_2 = CodeBlock { "Reference"; }
importExcel_2 = Data.ImportExcel(file=file_from_path, sheetName=code_block_2)
reference_bim_coordinates = CodeBlock { [[0,-10586,0,0,0],[-16125,-10586,0,0,0]]; }
inspection_image_path = StringInput("D:/Test")

# group: Transfer GPS/IMU into BIM
transfer_matrix = Python(IN[0]=importExcel_2, IN[1]=reference_bim_coordinates)  # CPython3
# ---------- transfer_matrix.python (81 lines) ----------
#Copyright(c) 2023, Cheng ZHANG

# Load the Python Standard and DesignScript Libraries
import clr
clr.AddReference('ProtoGeometry')
from Autodesk.DesignScript.Geometry import *

import sys
sys.path.append('E:\Anaconda\envs\MYGHT\Lib\site-packages')
import System
import os
import math
from pyproj import CRS
from pyproj import Transformer

# The inputs to this node will be stored as a list in the IN variables.
dataEnteringNode = IN

#transfer gps data to decimal
def decimal_coords(coords, ref):
 decimal_degrees = coords[0] + coords[1] / 60 + coords[2] / 3600
 if ref == 'S' or ref == 'W':
     decimal_degrees = -decimal_degrees
 return decimal_degrees
 
#WGS84坐标转高斯坐标
crs_WGS84 = CRS.from_epsg(4326)  # WGS84地理坐标系
def WGS84ToGK_Single(lat, lon):
    """
    WGS84坐标转高斯坐标
    :param lat:  WGS84坐标纬度
    :param lon:  WGS84坐标经度
    :return: 高斯坐标x,y
    """
    d = int((lon + 1.5) / 3)
    format = '+proj=tmerc +lat_0=0 +lon_0=' + str(d * 3) + ' +k=1 +x_0=500000 +y_0=0 +ellps=WGS84 +units=m +no_defs'
    crs_GK = CRS.from_proj4(format)
    transformer = Transformer.from_crs(crs_WGS84, crs_GK)
    x, y = transformer.transform(lat, lon)
    return x, y

#Calculate the transfer matrix from local coordinates to BIM coordinates
def transfermatrix_local_to_bim(locP1,locP2,bimP1,bimP2):
    locx1 = locP1[0]
    locy1 = locP1[1]
    locz1 = locP1[2]
    locx2 = locP2[0]
    locy2 = locP2[1]
    bimx1 = bimP1[0]
    bimy1 = bimP1[1]
    bimz1 = bimP1[2]
    bimx2 = bimP2[0]
    bimy2 = bimP2[1]
    cosangle = ((locx1-locx2)*(bimx1-bimx2)+(locy1-locy2)*(bimy1-bimy2))/((locx1-locx2)**2+(locy1-locy2)**2)
    sinangle = ((locx1-locx2)*(bimy1-bimy2)-(locy1-locy2)*(bimx1-bimx2))/((locx1-locx2)**2+(locy1-locy2)**2)
    dx = bimx1-locx1*cosangle+locy1*sinangle
    dy = bimy1-locx1*sinangle-locy1*cosangle
    dz = 1000*locz1-bimz1
    transfermatrix = [cosangle,sinangle,dx,dy,dz]
    return transfermatrix

refGPSPoints = IN[0]
BIMrefPoint = IN[1]
ImageGPS = []
for i in range(len(refGPSPoints)): 
    GPS = refGPSPoints[i]
    lat = GPS[0]
    lon = GPS[1]
    alt = GPS[2]
    [localx,localy] = WGS84ToGK_Single(lat, lon)
    GPScoords = [localx,localy,alt]
    ImageGPS.append(GPScoords)

locP1 = ImageGPS[0]
locP2 = ImageGPS[1]
bimP1 = BIMrefPoint[0]
bimP2 = BIMrefPoint[1]

transfermatrix = transfermatrix_local_to_bim(locP1,locP2,bimP1,bimP2)
# Assign your output to the OUT variable.
OUT = transfermatrix
# ----------------------------------------
transfer_gps_and_imu_into = Python(IN[0]=importExcel, IN[1]=transfer_matrix, IN[2]=inspection_image_path)  # "Transfer GPS and IMU into Pyhsical Parameters in BIM"; CPython3
# ---------- transfer_gps_and_imu_into.python (78 lines) ----------
#Copyright(c) 2023, Cheng ZHANG

# Load the Python Standard and DesignScript Libraries
import clr
clr.AddReference('ProtoGeometry')
from Autodesk.DesignScript.Geometry import *

import sys
sys.path.append('E:\Anaconda\envs\MYGHT\Lib\site-packages')
import exif
from exif import Image
import System
import os
import math
from pyproj import CRS
from pyproj import Transformer

# The inputs to this node will be stored as a list in the IN variables.
dataEnteringNode = IN

#transfer gps data to decimal
def decimal_coords(coords, ref):
 decimal_degrees = coords[0] + coords[1] / 60 + coords[2] / 3600
 if ref == 'S' or ref == 'W':
     decimal_degrees = -decimal_degrees
 return decimal_degrees

#WGS84坐标转高斯坐标
crs_WGS84 = CRS.from_epsg(4326)  # WGS84地理坐标系
def WGS84ToGK_Single(lat, lon):
    """
    WGS84坐标转高斯坐标
    :param lat:  WGS84坐标纬度
    :param lon:  WGS84坐标经度
    :return: 高斯坐标x,y
    """
    d = int((lon + 1.5) / 3)
    format = '+proj=tmerc +lat_0=0 +lon_0=' + str(d * 3) + ' +k=1 +x_0=500000 +y_0=0 +ellps=WGS84 +units=m +no_defs'
    crs_GK = CRS.from_proj4(format)
    transformer = Transformer.from_crs(crs_WGS84, crs_GK)
    x, y = transformer.transform(lat, lon)
    return x, y

# Place your code below this line
#file_root = IN[0]
GPSPoints = IN[0]
transfermatrix = IN[1]
file_root = IN[2]+'/UAV image'
filetype = '.JPG'
file_list = os.listdir(file_root)
Name = []
for img_name in file_list:
    Name.append(img_name)

cosangle = transfermatrix[0]
sinangle = transfermatrix[1]
dx = transfermatrix[2]
dy = transfermatrix[3]
dz = transfermatrix[4]

ImageGPS = []
#ImagePath = []
ImageName = []

for i in range(len(GPSPoints)): 
    GPS = GPSPoints[i]
    lat = GPS[0]
    lon = GPS[1]
    alt = GPS[2]
    [localx,localy] = WGS84ToGK_Single(lat, lon)
    bimx = round(localx*cosangle-localy*sinangle+dx)
    bimy = round(localx*sinangle+localy*cosangle+dy)
    bimz = round(1000*alt-dz)
    GPScoords = [Name[i],bimx,bimy,bimz,0,0]
    ImageGPS.append(GPScoords)

# Assign your output to the OUT variable.
OUT = ImageGPS
# ----------------------------------------

inspected_facade = DSModelElementSelection()  # 1 picked in the model

# group: Configure virtual camera and export BIM template images
boolean = BoolSelector(false)
createPerspectiveViews = Python(IN[0]=transfer_gps_and_imu_into, IN[1]=inspected_facade, IN[2]=boolean)  # CPython3
# ---------- createPerspectiveViews.python (49 lines) ----------
#Copyright(c) 2023, Cheng ZHANG

# Load the Python Standard and DesignScript Libraries
import sys
import clr
clr.AddReference('ProtoGeometry')
from Autodesk.DesignScript.Geometry import *

#导入revit节点，如果要使用revit节点中的方法
clr.AddReference("RevitNodes")
from Revit.Elements import *

import os
localapp = os.getenv(r'LOCALAPPDATA')
sys.path.append(os.path.join(localapp, r'python-3.8.3-embed-amd64\Lib\site-packages'))
import numpy as np
import math

import random

# The inputs to this node will be stored as a list in the IN variables.
dataEnteringNode = IN

# Place your code below this line
NameGPS = IN[0]
element1 = IN[1]
B1 = IN[2]
CameraView = []
errorGPS = 1
errorIMU = 1
#Set distamce value to calulate target point based on view point

for temp in NameGPS:
    ViewName = temp[0]
    x1 = temp[1] + random.randint(1,2*errorGPS) - errorGPS
    y1 = temp[2] + random.randint(1,2*errorGPS) - errorGPS
    z1 = temp[3] + random.randint(1,2*errorGPS) - errorGPS
    yaw = (temp[4] + random.randint(1,errorIMU))*math.pi/180
    pitch = (temp[5] + random.randint(1,errorIMU))*math.pi/180
    P1 = Point.ByCoordinates(x1,y1,z1)
    x2 = x1 - 10000*np.sin(yaw)*np.cos(pitch)
    y2 = y1 + 10000*np.cos(yaw)*np.cos(pitch)
    z2 = z1 - 10000*np.sin(pitch)
    P2 = Point.ByCoordinates(x2,y2,z2)
    View = Views.PerspectiveView.ByEyePointAndTarget(P1,P2,element1,ViewName,B1)
    CameraView.append(View)

# Assign your output to the OUT variable.
OUT = CameraView
# ----------------------------------------
camera_parameters = CodeBlock()
# ---------- camera_parameters.designscript (4 lines) ----------
pixel_x_dimension = 848;
pixel_y_dimension = 480;
horAngles = 60;
vertAngles = horAngles*pixel_y_dimension/pixel_x_dimension;
# ----------------------------------------
setFieldOfView = Custom[PerspectiveView.SetFieldOfView](PerspectiveViews=createPerspectiveViews, HorizontalAngle=camera_parameters.horAngles, VerticalAngle=camera_parameters.vertAngles)  # package Morpheus; Changes the field of view of perspective views. Enter degrees.
flatten = List.Flatten(list=setFieldOfView)
export_range = ExportRangeUi("CurrentView")
image_file_type = ImageFileTypeUi("JPEGLossless")
zoom_fit_type = ZoomFitTypeUi("FitToPage")
image_resolution = ImageResolutionUi("DPI_72")
zoom_percentage = CodeBlock { ZoomPercentage = 100; }
fit_direction_type = FitDirectionTypeUi("Horizontal")
boolean_2 = BoolSelector(true)
exportTemplateImage = Python(IN[0]=flatten, IN[1]=inspection_image_path, IN[2]=export_range, IN[3]=image_file_type, IN[4]=zoom_fit_type, IN[5]=camera_parameters.pixel_x_dimension, IN[6]=image_resolution, IN[7]=zoom_percentage, IN[8]=fit_direction_type, IN[9]=boolean_2)  # CPython3
# ---------- exportTemplateImage.python (103 lines) ----------
#Copyright(c) 2015, Konrad K Sobon
# @arch_laboratory, http://archi-lab.net

import clr
clr.AddReference('ProtoGeometry')
from Autodesk.DesignScript.Geometry import *

# Import Element wrapper extension methods
clr.AddReference('RevitNodes')
import Revit
clr.ImportExtensions(Revit.Elements)

# Import geometry conversion extension methods
clr.ImportExtensions(Revit.GeometryConversion)

# Import DocumentManager and TransactionManager
clr.AddReference('RevitServices')
import RevitServices
from RevitServices.Persistence import DocumentManager
from RevitServices.Transactions import TransactionManager

doc = DocumentManager.Instance.CurrentDBDocument
uiapp = DocumentManager.Instance.CurrentUIApplication
app = uiapp.Application

# Import RevitAPI
clr.AddReference('RevitAPI')
import Autodesk
from Autodesk.Revit.DB import *

import System
from System import Array
from System.Collections.Generic import *

import sys
pyt_path = r'C:\Program Files (x86)\IronPython 2.7\Lib'
sys.path.append(pyt_path)

#The inputs to this node will be stored as a list in the IN variable.
dataEnteringNode = IN

views = UnwrapElement(IN[0])
#filePath = IN[1]
filePath1 = IN[1]+'/BIM image'
filePath = filePath1 +'/'+'BIM'
exportRange = System.Enum.Parse(Autodesk.Revit.DB.ExportRange, IN[2])
fileType = System.Enum.Parse(Autodesk.Revit.DB.ImageFileType, IN[3])
zoomType = System.Enum.Parse(Autodesk.Revit.DB.ZoomFitType, IN[4])
pixelSize = IN[5]
imageRes = System.Enum.Parse(Autodesk.Revit.DB.ImageResolution, IN[6])
zoom = IN[7]
fitDirection = System.Enum.Parse(Autodesk.Revit.DB.FitDirectionType, IN[8])
RunIt = IN[9]

def CreateViewSet(views):
	viewSet = List[ElementId]()
	for i in views:
		viewSet.Add(i.Id)
	return viewSet

if RunIt:
	try:
		errorReport = None
		ieo = ImageExportOptions()
		ieo.FilePath = filePath
		
		if fileType != None:
			ieo.HLRandWFViewsFileType = fileType
		
		if zoomType != None:
			ieo.ZoomType = zoomType
			if ieo.ZoomType == ZoomFitType.FitToPage:
				if imageRes != None:
					ieo.ImageResolution = imageRes
				if pixelSize != None:
					ieo.PixelSize = pixelSize
				if fitDirection != None:
					ieo.FitDirection = fitDirection
			elif ieo.ZoomType == ZoomType.Zoom:
				if zoom != None:
					ieo.Zoom = zoom
		
		if len(views) > 1:
			ieo.ExportRange = ExportRange.SetOfViews
			ieo.SetViewsAndSheets(CreateViewSet(views))
		else:
			ieo.ExportRange = exportRange
		
		TransactionManager.Instance.EnsureInTransaction(doc)
		doc.ExportImage(ieo)
		TransactionManager.Instance.TransactionTaskDone()
	except:
		# if error accurs anywhere in the process catch it
		import traceback
		errorReport = traceback.format_exc()
else:
	errorReport = "RunIt is set to False."

#Assign your output to the OUT variable
if errorReport == None:
	OUT = IN[1]
else:
	OUT = errorReport
# ----------------------------------------
reviseFileName = Python(IN[0]=exportTemplateImage)  # CPython3
# ---------- reviseFileName.python (34 lines) ----------
#Copyright(c) 2023, Cheng ZHANG

# Load the Python Standard and DesignScript Libraries
import sys
import clr
clr.AddReference('ProtoGeometry')
from Autodesk.DesignScript.Geometry import *

import os

# The inputs to this node will be stored as a list in the IN variables.
dataEnteringNode = IN

# Place your code below this line

# 输⼊⽂件夹地址
path = IN[0]+'/BIM image'
files = os.listdir(path)
# 输出所有⽂件名，只是为了看⼀下
for file in files:
    print(file)
# 获取旧名和新名
i = 0
for file in files:
    # old 旧名称的信息
    old = path + os.sep + files[i]
    # new是新名称的信息，这⾥的操作是删除了最前⾯的'考拉很忙o - '共8个字符
    new = path + os.sep + file.replace('BIM - 3D View - ','').replace('-jpg','')
    # 新旧替换
    os.rename(old,new)
    i+=1

# Assign your output to the OUT variable.
OUT = IN[0]
# ----------------------------------------
contourDetection = Python(IN[0]=reviseFileName)  # CPython3
# ---------- contourDetection.python (57 lines) ----------
#Copyright(c) 2023, Cheng ZHANG

# Load the Python Standard and DesignScript Libraries
import sys
import clr
clr.AddReference('ProtoGeometry')
from Autodesk.DesignScript.Geometry import *

import sys
import os
localapp = os.getenv(r'LOCALAPPDATA')
sys.path.append(os.path.join(localapp, r'python-3.8.3-embed-amd64\Lib\site-packages'))
import cv2 as cv
import numpy as np

# The inputs to this node will be stored as a list in the IN variables.
dataEnteringNode = IN

# Place your code below this line
file_root = IN[0]+'/BIM image'
template_root = IN[0] +'/'+'Template'
file_list = os.listdir(file_root)

for img_name in file_list:
    img_path = file_root+'/'+img_name
    img = cv.imread(img_path)
    imgray = cv.cvtColor(img, cv.COLOR_BGR2GRAY) #灰度图
    gaussian = cv.GaussianBlur(imgray, (5, 5), 0)  #高斯图像去噪
    edge = cv.Canny(gaussian,100,200,3) #Canny边缘检测
    contours, hierarchy = cv.findContours(edge, cv.RETR_TREE, cv.CHAIN_APPROX_NONE) #轮廓检测
    #通过是否存在父轮廓和子轮廓筛选闭合轮廓,进一步利用轮廓面积阈值筛选结构特征轮廓
    contours_closed = []
    hierarchy_list = hierarchy.tolist()
    for i in range(len(hierarchy_list[0])):
        if hierarchy_list[0][i][3] == -1: # 判断没有父轮廓
            if hierarchy_list[0][i][2] != -1: #判断存在子轮廓
                 if cv.contourArea(contours[i]) > 10000: #判断轮廓面积是否大于阈值
                    contours_closed.append(contours[i])
    
    contour_final = []
    contour_area = 0
    for contour in contours_closed:
        if cv.contourArea(contour) > contour_area:
            contour_final = contour
            contour_area = cv.contourArea(contour)
    
    contour_draw = []
    contour_draw.append(contour_final)
    #画出轮廓
    mask=np.zeros(img.shape,np.uint8)
    dst = cv.drawContours(mask, contour_draw, -1,(255, 255, 255), -1)
    
    realpath=template_root+'/'+img_name
    cv.imwrite(realpath,dst)

# Assign your output to the OUT variable.
OUT = IN[0]
# ----------------------------------------

ght_based_component_detection = Python(IN[0]=contourDetection)  # CPython3
# ---------- ght_based_component_detection.python (644 lines) ----------
#Copyright(c) 2023, Cheng ZHANG

# Load the Python Standard and DesignScript Libraries
import sys
import clr
clr.AddReference('ProtoGeometry')
from Autodesk.DesignScript.Geometry import *

import os
sys.path.append('E:\Anaconda\envs\MYGHT\Lib\site-packages')
#localapp = os.getenv(r'LOCALAPPDATA')
#sys.path.append(os.path.join(localapp, r'python-3.8.3-embed-amd64\Lib\site-packages'))
import numpy as np
import cv2
from matplotlib import pyplot as plt
import sys

#some basic functions for ease
def load_img(name: str,mode: int) -> np.ndarray:
    return cv2.imread(name, mode)

def show_img(title: str,img: np.ndarray,wait: int) -> int:
    cv2.imshow(title, img)
    k = cv2.waitKey(wait)
    cv2.destroyWindow(title)
    return k

def save_img(name,img):
    if type(name) == str:
        cv2.imwrite(name, img)
    else:
        [cv2.imwrite("out/"+n+".jpg",i) for n,i in zip(name,img)]

#finding edge positions only
def getEdgePositions(img):
    positions = []
    m, n = img.shape
    for a in range(m):
        for b in range(n):
            if (img[a, b]!=0):
                positions.append((a, b))
    return positions

#finding edge positions considering the GPS error
def getEdgePositionsWithinGPSError(img,GPSRange):
    positions = []
    m, n = GPSRange.shape
    for a in range(m):
        for b in range(n):
            if (img[a, b]!=0) and (GPSRange[a, b]!=0) and a>100 and b>300 and b<600:
                positions.append((a, b))
    return positions

#Calculate the searching range based on the template image and GPS errors
def SetMatchingRange(template,GPSError):
    # convert template to grayscale
    gray = cv2.cvtColor(template, cv2.COLOR_BGR2GRAY)
    # make anything not white into black
    mask = gray.copy()
    mask[mask!=255] = 0
    # invert mask so center is white and outside is black
    mask = 255 - mask
    # close open mask to clean up small regions and make 3 channels
    kernel = cv2.getStructuringElement(cv2.MORPH_ELLIPSE, (5,5))
    mask = cv2.morphologyEx(mask, cv2.MORPH_OPEN, kernel)
    mask = cv2.morphologyEx(mask, cv2.MORPH_CLOSE, kernel)
    mask = cv2.cvtColor(mask, cv2.COLOR_GRAY2BGR)
    # erode mask
    kernel = cv2.getStructuringElement(cv2.MORPH_ELLIPSE, GPSError)
    erode = cv2.morphologyEx(mask, cv2.MORPH_ERODE, kernel)
    # dilate mask and make 3 channels
    kernel = cv2.getStructuringElement(cv2.MORPH_ELLIPSE, GPSError)
    dilate = cv2.morphologyEx(mask, cv2.MORPH_DILATE, kernel)
    # merge image onto dilated mask using mask
    result = np.where(mask==(255,255,255), mask, dilate)
    # merge inverted erode onto result using erode
    result = np.where(erode==(255,255,255), (255-erode), result)
    GPSRange = cv2.cvtColor(result, cv2.COLOR_BGR2GRAY)
    return GPSRange

#reference point is taken as avg of all edge positions pixels
def getReferencePoint(edgePositions):
    a = 0
    b = 0
    for i in range(len(edgePositions)):
        a = a + edgePositions[i][0]
        b = b + edgePositions[i][1]
    a = a/len(edgePositions)
    b = b/len(edgePositions)
    return (int(a), int(b))

#constructing the R-table to get structure of template
def rTable(img, refPoint, edgePositions):
    sobelx64f = cv2.Sobel(img,cv2.CV_64F,1,0,ksize=5)   #possibly tweaked
    abs_sobel64f = np.absolute(sobelx64f)
    rTable = {}
    for i, point in enumerate(edgePositions):
        rx = refPoint[0] - point[0]
        ry = refPoint[1] - point[1]
        r = (rx, ry)
        phi = abs_sobel64f[point[0], point[1]]
        if(phi not in list(rTable.keys())):
            rTable[phi] = [r]
        else:
            rTable[phi].append(r)
    rTable['refPoint'] = refPoint
    return rTable

#finding rTable for all theta with a jump of angle degrees. The tables are all stored in a list of length 360/angle.
def rTableWithRotation(templateCanny, angleRange, angle):
    print('Constructing rTable started')
    rTableWithRotation = []
    rows, columns = templateCanny.shape
    for i in range(int(angleRange/angle)):
        theta = angle*i
        M = cv2.getRotationMatrix2D((columns/angle,rows/angle),theta,1)
        templateCannyRotated = cv2.warpAffine(templateCanny,M,(columns,rows))
        templateEdgePositions = getEdgePositions(templateCannyRotated)
        templateRefPoint = getReferencePoint(templateEdgePositions)
        rTableTheta = rTable(templateCannyRotated, templateRefPoint, templateEdgePositions)
        rTableWithRotation.append(rTableTheta)
    print('Constructing rTable finished')
    return rTableWithRotation

#finding the accumulatorTable for the main picture
def accumulatorTable(pictureCanny, template_rTable, GPSRange, angleRange, angle):
    print('Matching process started')
    rows = pictureCanny.shape[0]
    columns = pictureCanny.shape[1]
    
    #refPoint = template_rTable[0]['refPoint']
    #pictureEdgePositions = getEdgePositions(pictureCanny)
    
    pictureEdgePositions = getEdgePositionsWithinGPSError(pictureCanny,GPSRange)
    
    accumulatorTable = np.ndarray((int(angleRange/angle), rows, columns))
    sobelx64f = cv2.Sobel(pictureCanny,cv2.CV_64F,1,0,ksize=5)
    abs_sobel64f = np.absolute(sobelx64f)
    
    for theta, rTableTheta in enumerate(template_rTable):
        for i, edgePoint in enumerate(pictureEdgePositions):
            phi = abs_sobel64f[edgePoint[0], edgePoint[1]]
            if (phi in list(rTableTheta.keys())):
                temp = rTableTheta[phi]
                for r, vector in enumerate(temp):
                    x = edgePoint[0] + vector[0]
                    y = edgePoint[1] + vector[1]
                    if (x>=0 and x<rows) and (y>=0 and y<columns):
                        accumulatorTable[theta, x, y]+=1
            else:
                continue
    print('Matching process finished')
    return accumulatorTable

#getting back the original image
def reconstruction(rTable, theta, a, b, pictureCanny,GPSRange, angle):
    print('Reconstruction process started')
    rTable = rTable[int(theta)]
    
    #pictureEdgePositions = getEdgePositions(pictureCanny)
    
    pictureEdgePositions = getEdgePositionsWithinGPSError(pictureCanny,GPSRange)
    draw = np.ones_like(pictureCanny)*255
    mask = np.ones_like(pictureCanny)*255
    maskingPoints = []
    maskingPointsReal= []
    rows = pictureCanny.shape[0]
    columns = pictureCanny.shape[1]
    sobelx64f = cv2.Sobel(pictureCanny,cv2.CV_64F,1,0,ksize=5)
    abs_sobel64f = np.absolute(sobelx64f)

    for i, edgePoint in enumerate(pictureEdgePositions):
        phi = abs_sobel64f[edgePoint[0], edgePoint[1]]
        if (phi in list(rTable.keys())):
            temp = rTable[phi]
            for r, vector in enumerate(temp):
                x = a - vector[0]
                y = b - vector[1]
                x1 = edgePoint[0]
                y1 = edgePoint[1]
                if (x>=0 and x<rows) and (y>=0 and y<columns):
                    cv2.circle(draw,(y, x), 1, (0,0,255), -1)
                    cv2.circle(mask,(y1, x1), 1, (0,0,255), -1)
                    maskingPoints.append((y, x))
                    maskingPointsReal.append((y1,x1))
        else:
            continue
    
    maskingPoints = list(set(maskingPoints))
    maskingPointsReal = list(set(maskingPointsReal))

    #cv2.fillConvexPoly(mask, np.int32(maskingPoints), (1.0, 1.0, 1.0), 16, 0)

    # M = cv2.getRotationMatrix2D((columns/angle,rows/angle),theta*angle,1)
    # print(theta*angle)
    # mask = cv2.warpAffine(mask,M,(columns,rows))
    cv2.imwrite('C:/Users/19644/Desktop/draw.png',draw)
    cv2.imwrite('C:/Users/19644/Desktop/mask.png',mask)
    print('Reconstruction process finished')
    return draw, maskingPoints, maskingPointsReal

def get_distance_point2line(point, line):
    """
    Args:
        point: [x0, y0]
        line: [x1, y1, x2, y2]
    """
    line_point1, line_point2 = np.array(line[0:2]), np.array(line[2:])
    vec1 = line_point1 - point
    vec2 = line_point2 - point
    distance = np.abs(np.cross(vec1, vec2)) / np.linalg.norm(line_point1 - line_point2)
    return distance

#计算平均差
def meandev(numbers):
    mean = sum(numbers)/len(numbers)
    dev = 0
    for n in numbers:
        dev = dev + abs(n-mean)
    
    return dev

# 计算两直线交点函数
def cross_point(line1,line2):
    x1=line1[0]
    y1=line1[1]
    x2=line1[2]
    y2=line1[3]
    
    x3=line2[0]
    y3=line2[1]
    x4=line2[2]
    y4=line2[3]
    
    # L2直线斜率不存在操作
    if (x4-x3)==0:
        k2=None
        b2=0
        x=x3
        # 计算k1,由于点均为整数，需要进行浮点数转化
        k1=(y2-y1)*1.0/(x2-x1)
        # 整型转浮点型是关键
        b1=y1*1.0-x1*k1*1.0
        y=k1*x*1.0+b1*1.0
    elif (x2-x1)==0:
        k1=None
        b1=0
        x=x1
        k2=(y4-y3)*1.0/(x4-x3)
        b2=y3*1.0-x3*k2*1.0
        y=k2*x*1.0+b2*1.0
    else:
        # 计算k1,由于点均为整数，需要进行浮点数转化
        k1=(y2-y1)*1.0/(x2-x1)
        # 斜率存在操作
        k2=(y4-y3)*1.0/(x4-x3) 
        # 整型转浮点型是关键
        b1=y1*1.0-x1*k1*1.0
        b2=y3*1.0-x3*k2*1.0
        x=(b2-b1)*1.0/(k1-k2)
        y=k1*x*1.0+b1*1.0    
    return [x,y]

def EdgeFitting(maskingPointsFinal):
    coordinates = [[[],[]],[[],[]],[[],[]],[[],[]]]
    for i, MaskingPointF in enumerate(maskingPointsFinal):
        for j, maskingP in enumerate(MaskingPointF):
            coordinates[i][0].append(maskingP[0])
            coordinates[i][1].append(maskingP[1])
    
    #对分类到边缘段的每组点进行线性拟合
    lines = []
    for i, Coords in enumerate(coordinates):
        x = Coords[0]
        y = Coords[1]
        xdev = meandev(x)
        ydev = meandev(y)
        if xdev < ydev:
            poly = np.polyfit(y,x,deg=1)
            y1 = min(y)
            y2 = max(y)
            x1 = np.polyval(poly, y1)
            x2 = np.polyval(poly, y2)
        else:
            poly = np.polyfit(x,y,deg=1)
            x1 = min(x)
            x2 = max(x)
            y1 = np.polyval(poly, x1)
            y2 = np.polyval(poly, x2)
        lines.append([x1,y1,x2,y2])
    
    #计算拟合后四条直线的所有交点
    crossPoint = []
    xmin = 3000
    xmax = 0
    ymin = 3000
    ymax = 0
    for i, line1 in enumerate(lines):
        for j, line2 in enumerate(lines):
            if line1 != line2:
                x1=line1[0]
                y1=line1[1]
                x2=line1[2]
                y2=line1[3]
                
                x3=line2[0]
                y3=line2[1]
                x4=line2[2]
                y4=line2[3]
                
                ee = 50
                if abs(x1-x2) < ee:
                    if abs(x3-x4) > ee:
                        xy = cross_point(line1,line2)
                        crossPoint.append(xy)
                        if xy[0] < xmin:
                            xmin = xy[0]
                        if xy[0] > xmax:
                            xmax = xy[0]
                        if xy[1] < ymin:
                            ymin = xy[1]
                        if xy[1] > ymax:
                            ymax = xy[1]
                else:
                    if abs(x3-x4) < ee:
                        xy = cross_point(line1,line2)
                        crossPoint.append(xy)
                        if xy[0] < xmin:
                            xmin = xy[0]
                        if xy[0] > xmax:
                            xmax = xy[0]
                        if xy[1] < ymin:
                            ymin = xy[1]
                        if xy[1] > ymax:
                            ymax = xy[1]
    
    #分类交点，获取对应四角点的坐标
    leftUp = []
    leftDown = []
    rightUp = []
    rightDown = []
    for i, crossP in enumerate(crossPoint):
        ee = 100
        if abs(crossP[0]-xmin) < ee:
            if abs(crossP[1]-ymax) < ee:
                leftUp = crossP
            elif abs(crossP[1]-ymin) < ee:
                leftDown = crossP
        elif abs(crossP[0]-xmax) < ee:
            if abs(crossP[1]-ymax) < ee:
                rightUp = crossP
            elif abs(crossP[1]-ymin) < ee:
                rightDown = crossP
    
    return leftUp, leftDown, rightUp, rightDown

#考虑弧形窗户的边界点分组
def reconstructionMatchingWithArcTop(maskingPoints,maskingPointsReal, draw):
    print('Reconstruction matching started')
    
    xcoord = []
    ycoord = []
    for i, templateMaskingPoint in enumerate(maskingPoints):
        xcoord.append(templateMaskingPoint[0])
        ycoord.append(templateMaskingPoint[1])
        
    xmin = min(xcoord)
    xmax = max(xcoord)
    ymin = min(ycoord)
    ymax = max(ycoord)
    
    maskingPointsCategory = [[],[],[],[]]
    for i, templateMaskingPoint in enumerate(maskingPoints):
        dis = 2
        x = templateMaskingPoint[0]
        y = templateMaskingPoint[1]
        if abs(x-xmin) < dis and abs(y-ymax) > dis:
            maskingPointsCategory[0].append(templateMaskingPoint)
        elif abs(x-xmax) < dis and abs(y-ymax) > dis:
            maskingPointsCategory[1].append(templateMaskingPoint)
        elif abs(y-ymax) < dis and abs(x-xmax) > dis and abs(x-xmin) > dis:
            maskingPointsCategory[2].append(templateMaskingPoint)
        elif abs(y-ymax) > 20 and abs(x-xmax) > dis and abs(x-xmin) > dis:
            maskingPointsCategory[3].append(templateMaskingPoint)
    
    lineNum = 3
    for i, tempPoint in enumerate(maskingPointsReal):
        ycoord.append(tempPoint[1])
    ymaxR = max(ycoord)
    
    maskingPointsFinal = [[],[],[],[]]
    drawFinal = np.ones_like(draw)*255
    
    for j, templateMaskingPoint in enumerate(maskingPointsCategory[0]):
        dis = 100000
        for k, realMaskingPoint in enumerate(maskingPointsReal):
            dy = abs(templateMaskingPoint[1] - realMaskingPoint[1])
            dx = realMaskingPoint[0] - templateMaskingPoint[0]
            if dy < 2 and dx < dis:
                dis = dx
                tempMaskingPoint = realMaskingPoint
        if abs(dis) < 20:
            maskingPointsFinal[0].append(tempMaskingPoint)
    
    for j, templateMaskingPoint in enumerate(maskingPointsCategory[1]):
        dis = -100000
        for k, realMaskingPoint in enumerate(maskingPointsReal):
            dy = abs(templateMaskingPoint[1] - realMaskingPoint[1])
            dx = realMaskingPoint[0] - templateMaskingPoint[0]
            if dy < 2 and dx > dis:
                dis = dx
                tempMaskingPoint = realMaskingPoint
        if abs(dis) < 20:
            maskingPointsFinal[1].append(tempMaskingPoint)
    
    for j, templateMaskingPoint in enumerate(maskingPointsCategory[2]):
        dis = -100000
        for k, realMaskingPoint in enumerate(maskingPointsReal):
            dy = realMaskingPoint[1] - templateMaskingPoint[1]
            dx = abs(templateMaskingPoint[0] - realMaskingPoint[0])
            if dx < 2 and dy > dis:
                dis = dy
                tempMaskingPoint = realMaskingPoint
        if abs(dis) < 20:
            maskingPointsFinal[2].append(tempMaskingPoint)
    
    for j, templateMaskingPoint in enumerate(maskingPointsCategory[2]):
        dis = 100000
        for k, realMaskingPoint in enumerate(maskingPointsReal):
            dy = abs(templateMaskingPoint[1] - realMaskingPoint[1])
            dx = abs(templateMaskingPoint[0] - realMaskingPoint[0])
            dis1 = max([dx,dy])
            if dis1 < dis:
                dis = dis1
                tempMaskingPoint = realMaskingPoint
        if dis < 20:
            maskingPointsFinal[3].append(tempMaskingPoint)
    
    print('Reconstruction matching finished')
    return drawFinal, maskingPointsFinal, lineNum

def EdgeFittingWithArcTop(maskingPointsFinal, lineNum):
    if lineNum == 4:
        LineCoordinates = [[[],[]],[[],[]],[[],[]],[[],[]]]
        ArcCoordinates = []
        for i, MaskingPointF in enumerate(maskingPointsFinal):
            for j, maskingP in enumerate(MaskingPointF):
                LineCoordinates[i][0].append(maskingP[0])
                LineCoordinates[i][1].append(maskingP[1])
    elif lineNum == 3:
        LineCoordinates = [[[],[]],[[],[]],[[],[]]]
        ArcCoordinates = []
        xCoord = []
        yCoord = []
        for i, MaskingPointF in enumerate(maskingPointsFinal):
            if i == 3:
                for j, maskingP in enumerate(MaskingPointF):
                    if xCoord != []:
                        if maskingP[0] not in xCoord:
                            xCoord.append(maskingP[0])
                            yCoord.append(maskingP[1])
                            ArcCoordinates.append((maskingP[0],maskingP[1]))
                    else:
                        xCoord.append(maskingP[0])
                        yCoord.append(maskingP[1])
                        ArcCoordinates.append((maskingP[0],maskingP[1]))
                    #ArcCoordinates.append((maskingP[0],maskingP[1]))
            else:
                for j, maskingP in enumerate(MaskingPointF):
                    LineCoordinates[i][0].append(maskingP[0])
                    LineCoordinates[i][1].append(maskingP[1])
    
    
    #对分类到边缘段的每组点进行线性拟合
    lines = []
    for i, Coords in enumerate(LineCoordinates):
        x = Coords[0]
        y = Coords[1]
        xdev = meandev(x)
        ydev = meandev(y)
        if xdev < ydev:
            poly = np.polyfit(y,x,deg=1)
            y1 = min(y)
            y2 = max(y)
            x1 = np.polyval(poly, y1)
            x2 = np.polyval(poly, y2)
            ArcCoordinates.append((round(x1),y1))
        else:
            poly = np.polyfit(x,y,deg=1)
            x1 = min(x)
            x2 = max(x)
            y1 = np.polyval(poly, x1)
            y2 = np.polyval(poly, x2)
            yMean = np.mean(y)
        lines.append([x1,y1,x2,y2])
    
    if lineNum == 3:
        yMean2 = np.mean(yCoord)
        ArcCoordinates.sort(key=lambda x:x[0],reverse=False)
        xArc = []
        yArc = []
        #img_copy = load_img(img_path,1)
        for point in ArcCoordinates:
            if abs(point[1] - yMean) > 100 and abs(point[1] - yMean2) < 500:
                xArc.append(point[0])
                yArc.append(point[1])
                #cv2.circle(img_copy,(point[0],point[1]), 1, (255,0,0), -1)
        #cv2.imwrite('C:/Users/19644/Desktop/img_copy.png',img_copy)
        
        #曲线边缘插值拟合
        xArc = np.array(xArc)
        yArc = np.array(yArc)
        coff = np.polyfit(xArc,yArc,5)
        def fitresult(xx):
            result = coff[0]*pow(xx,5) + coff[1]*pow(xx,4) + coff[2]*pow(xx,3) + coff[3]*pow(xx,2) + coff[4]*xx + coff[5]
            return result
        
   
    #计算所有拟合线段交点
    crossPoint = []
    for i, line1 in enumerate(lines):
        for j, line2 in enumerate(lines):
            x1=line1[0]
            y1=line1[1]
            x2=line1[2]
            y2=line1[3]
            
            x3=line2[0]
            y3=line2[1]
            x4=line2[2]
            y4=line2[3]
            
            k1 = abs((y1-y2)/(x1-x2))
            k2 = abs((y3-y4)/(x3-x4))
            
            if k1 > 1:
                if k2 < 1:
                    xy = cross_point(line1,line2)
                    crossPoint.append(xy)
            else:
                if k2 > 1:
                    xy = cross_point(line1,line2)
                    crossPoint.append(xy)
    if lineNum == 3:
        for i, line in enumerate(lines):
            x1 = line[0]
            x2 = line[2]
            if abs(x1-x2) < abs(line[1]-line[3]):
                xCross = x1
                yCross = float(fitresult(xCross))
                xy = [xCross,yCross]
                crossPoint.append(xy)
    
    xmin = 6000
    xmax = 0
    ymin = 6000
    ymax = 0
    for i, line in enumerate(lines):
        if xmin > min([line[0],line[2]]):
            xmin = min([line[0],line[2]])
        if xmax < max([line[0],line[2]]):
            xmax = max([line[0],line[2]])
        if ymin > min([line[1],line[3]]):
            ymin = min([line[1],line[3]])
        if ymax < max([line[1],line[3]]):
            ymax = max([line[1],line[3]])
    
    #分类交点，获取对应四角点的坐标
    leftUp = []
    leftDown = []
    rightUp = []
    rightDown = []
    for i, crossP in enumerate(crossPoint):
        ee = 100
        if abs(crossP[0]-xmin) < ee:
            if abs(crossP[1]-ymax) < ee:
                leftUp = crossP
            elif abs(crossP[1]-ymin) < ee:
                leftDown = crossP
        elif abs(crossP[0]-xmax) < ee:
            if abs(crossP[1]-ymax) < ee:
                rightUp = crossP
            elif abs(crossP[1]-ymin) < ee:
                rightDown = crossP
    
    
    downAverage = (leftDown[1]+rightDown[1])/2
    leftDown[1] = downAverage
    rightDown[1] = downAverage
    
    return leftUp, leftDown, rightUp, rightDown

def hough(picture,template,GPSError,angleRange,angle,img_name,InsImage,ImgCoordinates):
    pictureCanny = cv2.Canny(picture, 80, 160)
    #cv2.imwrite('C:/Users/19644/Desktop/pictureCanny.png',pictureCanny)
    templateCanny = cv2.Canny(template, 100, 200)
    #cv2.imwrite('C:/Users/19644/Desktop/templateCanny.png',templateCanny)
    GPSRange = SetMatchingRange(template,GPSError)
    #cv2.imwrite('C:/Users/19644/Desktop/GPSRange.png',GPSRange)
    template_rTable = rTableWithRotation(templateCanny,angleRange, angle)
    picture_accumulatorTable = accumulatorTable(pictureCanny, template_rTable,GPSRange,angleRange, angle)
    theta, a, b = np.unravel_index(picture_accumulatorTable.argmax(),picture_accumulatorTable.shape)
    draw, maskingPoints, maskingPointsReal = reconstruction(template_rTable, theta, a, b, pictureCanny,GPSRange,angle)
    drawFinal, maskingPointsFinal, lineNum = reconstructionMatchingWithArcTop(maskingPoints,maskingPointsReal, draw)
    leftUp, leftDown, rightUp, rightDown = EdgeFittingWithArcTop(maskingPointsFinal, lineNum)
    
    SaveInfo = [img_name, leftUp, leftDown, rightUp, rightDown]
    ImgCoordinates.append(SaveInfo)
    cv2.line(InsImage, (round(leftUp[0]), round(leftUp[1])), (round(leftDown[0]), round(leftDown[1])), (0, 0, 255), 2)
    cv2.line(InsImage, (round(leftUp[0]), round(leftUp[1])), (round(rightUp[0]), round(rightUp[1])), (0, 0, 255), 2)
    cv2.line(InsImage, (round(rightDown[0]), round(rightDown[1])), (round(rightUp[0]), round(rightUp[1])), (0, 0, 255), 2)
    cv2.line(InsImage, (round(rightDown[0]), round(rightDown[1])), (round(leftDown[0]), round(leftDown[1])), (0, 0, 255), 2)
    
    return ImgCoordinates, InsImage

##############GHT part##################################################################################################################################
#file_root = 'D:/Paper 1_Simulation experiment/Case1/Facade1'
file_root = IN[0]
InsImage_root = file_root+'/UAV image'
file_list = os.listdir(InsImage_root)
angle = 1
angleRange = 1
GPSError = (100,200)
ImgCoordinates = []
i = 1

for img in file_list:
    print('Processing Image ' + str(i))
    i+=1
    InsImage_path = file_root+'/UAV image/'+img
    img_name = img[:img.rindex('.')]
    TemImage_path = file_root+'/Template/'+img_name+'.jpg'
    
    InsImage = load_img(InsImage_path,1)
    TemImage = load_img(TemImage_path,1)
    InsImageGray = cv2.cvtColor(InsImage, cv2.COLOR_BGR2GRAY)
    
    ImgCoordinates, InsImage = hough(InsImageGray,TemImage,GPSError,angleRange, angle,img_name, InsImage, ImgCoordinates)
    
    result_path = file_root+'/Result/'+img_name+'.jpg'
    cv2.imwrite(result_path,InsImage)

# Assign your output to the OUT variable.
OUT = [IN[0],ImgCoordinates]
# ----------------------------------------
perspective_transformation = Python(IN[0]=ght_based_component_detection)  # CPython3
# ---------- perspective_transformation.python (91 lines) ----------
#Copyright(c) 2023, Cheng ZHANG

# Load the Python Standard and DesignScript Libraries
import sys
import clr
clr.AddReference('ProtoGeometry')
from Autodesk.DesignScript.Geometry import *

import os
sys.path.append('E:\Anaconda\envs\MYGHT\Lib\site-packages')
#localapp = os.getenv(r'LOCALAPPDATA')
#sys.path.append(os.path.join(localapp, r'python-3.8.3-embed-amd64\Lib\site-packages'))
import numpy as np
import cv2
from matplotlib import pyplot as plt
import sys

file_root = IN[0][0]
ImgCoordinates = IN[0][1]

def load_img(name: str,mode: int) -> np.ndarray:
    return cv2.imread(name, mode)

def PerspectiveTrans(inspectionImg, InspecImCoordinates, elevation, elevationCoord):
    src = np.float32(InspecImCoordinates)
    dst = np.float32(elevationCoord)
    PerspectiveTransM = cv2.getPerspectiveTransform(src, dst)
    
    elevationSize = (elevation.shape[1], elevation.shape[0])
    
    PerspectiveResult = cv2.warpPerspective(inspectionImg, PerspectiveTransM, elevationSize, borderMode=cv2.BORDER_CONSTANT, borderValue=(0,0,0))
    #PerspectiveResult = cv.warpPerspective(inspectionImg, PerspectiveTransM, elevationSize, borderMode=cv.BORDER_CONSTANT, borderValue=(255,255,255))
    
    return PerspectiveResult

elevation_path = file_root+'/'+'elevation.jpg'
elevation = cv2.imread(elevation_path)

elevationCoord_path = file_root+'/'+'elevationCoordinates.npy'
elevationCoordinates = np.load(elevationCoord_path)
elevationCoordinates = elevationCoordinates.tolist()

Image_Whole = np.ones(elevation.shape,np.uint8)*0
x_range = [[0,1674],[1675,3350],[3351,5024],[5025,6697]]
y_range = [[0,1321],[1322,2644],[2645,3965],[3966,5287],[5288,6609],[6610,7931],[7932,9253],[9254,10574],[10575,11896],[11897,13221]]
for i, ImgCoord in enumerate(ImgCoordinates):
    print('Processing Perspective Transformation ' + str(i))
    img_name = ImgCoord[0]
    leftUp = ImgCoord[1]
    leftDown = ImgCoord[2]
    rightUp = ImgCoord[3]
    rightDown = ImgCoord[4]
    InsImage_path = file_root+'/UAV image/'+img_name+'.jpg'
    inspectionImg = load_img(InsImage_path,1)
    InspecImCoordinates = [leftUp, leftDown, rightUp, rightDown]
    
    elevationCoord = elevationCoordinates[i]
    
    PerspectiveResult = PerspectiveTrans(inspectionImg, InspecImCoordinates, elevation, elevationCoord)
    Perspective_Path = file_root+'/Perspective/'+img_name+'.jpg'
    cv2.imwrite(Perspective_Path,PerspectiveResult)
    
    row = int((i)/4)+1
    colum = (i+1)%4
    if colum == 0:
        colum = 4
    
    mask = np.zeros(PerspectiveResult.shape[:2],np.uint8)
    mask[y_range[row-1][0]:y_range[row-1][1],x_range[colum-1][0]:x_range[colum-1][1]] = 1
    
    PerspectiveResultMasked = cv2.bitwise_and(PerspectiveResult,PerspectiveResult,mask=mask)
    Perspective_Path_new = file_root+'/Perspective_Croped/'+img_name+'.jpg'
    cv2.imwrite(Perspective_Path_new,PerspectiveResultMasked)
    
    Image_Whole = cv2.add(Image_Whole,PerspectiveResultMasked)
'''
    for x in range(elevation.shape[1]-1):
        for y in range(elevation.shape[0]-1):
            if x < x_range[colum-1][0] or x > x_range[colum-1][1] or y < y_range[row-1][0] or y > y_range[row-1][1]:
                PerspectiveResult[y,x] = (0,0,0)

    Perspective_Path_new = file_root+'/Perspective_Croped/'+img_name+'.jpg'
    cv2.imwrite(Perspective_Path_new,PerspectiveResultMasked)
    
    Image_Whole = cv2.add(Image_Whole,PerspectiveResultMasked)
    '''

perspective_whole_path = file_root+'.jpg'
cv2.imwrite(perspective_whole_path,Image_Whole)
# Assign your output to the OUT variable.
OUT = perspective_whole_path
# ----------------------------------------

# group: Import Orthophoto into 2D view
views = Views("Inspection Image")
create = archilab.Revit.Elements.ImageTypeOptions.Create(filePath=perspective_transformation)
create_2 = archilab.Revit.Elements.ImageTypes.Create(imageTypeOptions=create)
boundingBox = Element.BoundingBox(element=inspected_facade)
element_center = Python(IN[0]=boundingBox)  # CPython3
# ---------- element_center.python (21 lines) ----------
# Load the Python Standard and DesignScript Libraries
import sys
import clr
clr.AddReference('ProtoGeometry')
from Autodesk.DesignScript.Geometry import *

# The inputs to this node will be stored as a list in the IN variables.
dataEnteringNode = IN
boundingBox = IN[0]

# Place your code below this line
startPoint = IN[0].MinPoint
endPoint = IN[0].MaxPoint

x = (startPoint.X + endPoint.X)/2
y = (startPoint.Y + endPoint.Y)/2
z = (startPoint.Z + endPoint.Z - 4010)/2

wallCenter = Point.ByCoordinates(x,y,z)
# Assign your output to the OUT variable.
OUT = wallCenter
# ----------------------------------------
box_placement_types = BoxPlacementTypeUi("Center")
create_3 = archilab.Revit.Elements.ImagePlacementOptions.Create(location=element_center, boxPlacementType=box_placement_types)
create_4 = archilab.Revit.Elements.ImageInstances.Create(view=views, imageType=create_2, imagePlacementOptions=create_3)
element_dimension = Python(IN[0]=boundingBox)  # CPython3
# ---------- element_dimension.python (20 lines) ----------
# Load the Python Standard and DesignScript Libraries
import sys
import clr
clr.AddReference('ProtoGeometry')
from Autodesk.DesignScript.Geometry import *

# The inputs to this node will be stored as a list in the IN variables.
dataEnteringNode = IN
boundingBox = IN[0]

# Place your code below this line
startPoint = IN[0].MinPoint
endPoint = IN[0].MaxPoint

width = max([abs(startPoint.X - endPoint.X),abs(startPoint.Y - endPoint.Y)])
height = abs(startPoint.Z - endPoint.Z)-4010

Dimension = [width,height]
# Assign your output to the OUT variable.
OUT = Dimension
# ----------------------------------------
code_block_3 = CodeBlock(ElementD=element_dimension) { "Height"; width = ElementD[0]; height = ElementD[1]; }
setParameterByName = Element.SetParameterByName(element=create_4, parameterName=code_block_3.out0, value=code_block_3.height)

# group: Paint 3D model with inspection image (orthophoto)
faces = Element.Faces(element=inspected_facade)
pointAtParameter = Surface.PointAtParameter(surface=faces)
normalAtPoint = Surface.NormalAtPoint(surface=faces, point=pointAtParameter)
surface_index = CodeBlock { 0; }
getItemAtIndex = List.GetItemAtIndex(list=faces, index=surface_index)
code_block_4 = CodeBlock { "InspectionImage"; }
byName = Material.ByName(name=code_block_4)
add_image_to_material = Python(IN[0]=byName, IN[1]=perspective_transformation)  # IronPython2
# ---------- add_image_to_material.python (62 lines) ----------
#Alban de Chasteigner 2020
#twitter : @geniusloci_bim
#geniusloci.bim@gmail.com

import clr
clr.AddReference('RevitAPI')
from Autodesk.Revit.DB import *
clr.AddReference('RevitServices')
import RevitServices
from RevitServices.Persistence import DocumentManager
from RevitServices.Transactions import TransactionManager
doc = DocumentManager.Instance.CurrentDBDocument

def toList(obj):
    if hasattr(obj, '__iter__'): return obj
    else: return [obj]
    
mats = toList(UnwrapElement(IN[0]))
paths = toList(IN[1])

for mat, texturePath in zip(mats, paths):
	appearanceAssetId = mat.AppearanceAssetId
	assetElem = doc.GetElement(appearanceAssetId)
	TransactionManager.Instance.EnsureInTransaction(doc)
	with Visual.AppearanceAssetEditScope(doc) as editScope:
		editableAsset = editScope.Start(assetElem.Id)
		if (editableAsset.FindByName("BaseSchema")).Value == "GenericSchema":
			property = editableAsset.FindByName("generic_diffuse")
		elif (editableAsset.FindByName("BaseSchema")).Value == "CeramicSchema":
			property = editableAsset.FindByName("ceramic_color")
		elif (editableAsset.FindByName("BaseSchema")).Value == "ConcreteSchema":
			property = editableAsset.FindByName("concrete_color")
		elif (editableAsset.FindByName("BaseSchema")).Value == "MetallicPaintSchema":
			property = editableAsset.FindByName("metallicpaint_base_color")
		elif (editableAsset.FindByName("BaseSchema")).Value == "MasonryCMUSchema":
			property = editableAsset.FindByName("masonrycmu_color")	
		elif (editableAsset.FindByName("BaseSchema")).Value == "PlasticVinylSchema":
			property = editableAsset.FindByName("plasticvinyl_color")
		elif (editableAsset.FindByName("BaseSchema")).Value == "HardwoodSchema":
			property = editableAsset.FindByName("hardwood_color")
		elif (editableAsset.FindByName("BaseSchema")).Value == "StoneSchema":
			property = editableAsset.FindByName("stone_color")	
		elif (editableAsset.FindByName("BaseSchema")).Value == "SolidGlassSchema":
			property = editableAsset.FindByName("solidglass_transmittance_custom_color")
		elif (editableAsset.FindByName("BaseSchema")).Value == "PrismLayeredSchema":
			property = editableAsset.FindByName("layered_diffuse")
		elif (editableAsset.FindByName("BaseSchema")).Value == "PrismMetalSchema":
			property = editableAsset.FindByName("surface_roughness")			
		elif (editableAsset.FindByName("BaseSchema")).Value == "PrismOpaqueSchema":
			property = editableAsset.FindByName("opaque_albedo")
		elif (editableAsset.FindByName("BaseSchema")).Value == "PrismTransparentSchema":
			property = editableAsset.FindByName("surface_roughness")
		if property.NumberOfConnectedProperties == 0 :
			property.AddConnectedAsset("UnifiedBitmapSchema")
			connectedAsset = property.GetConnectedProperty(0)
			path = connectedAsset.FindByName("unifiedbitmap_Bitmap")
			path.Value = texturePath
			editScope.Commit(True)
	TransactionManager.Instance.TransactionTaskDone()

if isinstance(IN[0], list): OUT = mats
else: OUT = mats[0]
# ----------------------------------------
change_material_image_size = Python(IN[0]=add_image_to_material, IN[1]=code_block_3.width, IN[2]=code_block_3.height)  # IronPython2; unwired: IN[3]
# ---------- change_material_image_size.python (93 lines) ----------
#Alban de Chasteigner 2018
#twitter : @geniusloci_bim
#geniusloci.bim@gmail.com
#Inspired by Boris Shafiro from Autodesk
#https://apidocs.co/apps/revit/2019/2e09391a-6aec-f47f-a4e6-bf354bb8629f.htm

import clr
clr.AddReference('RevitAPI')
from Autodesk.Revit.DB import *
from Autodesk.Revit.DB.Visual import *

clr.AddReference('RevitServices')
import RevitServices
from RevitServices.Persistence import DocumentManager
from RevitServices.Transactions import TransactionManager
doc = DocumentManager.Instance.CurrentDBDocument
uiapp = DocumentManager.Instance.CurrentUIApplication
app = uiapp.Application
version=int(app.VersionNumber)
clr.AddReference('RevitNodes')
import Revit
clr.ImportExtensions(Revit.Elements)
clr.ImportExtensions(Revit.GeometryConversion)

def toList(obj):
    if hasattr(obj, '__iter__'): return obj
    else: return [obj]
    
mats = toList(UnwrapElement(IN[0]))
scaleWidht = IN[1]*12
scaleHeight = IN[2]*12
paths = toList(IN[3])

if version < 2021:
	UIunit = doc.GetUnits().GetFormatOptions(UnitType.UT_Length).DisplayUnits
else:
	UIunit = doc.GetUnits().GetFormatOptions(SpecTypeId.Length).GetUnitTypeId()

for mat, path in zip(mats, paths):
	assetElem = doc.GetElement(mat.AppearanceAssetId)
	TransactionManager.Instance.EnsureInTransaction(doc)
	with Visual.AppearanceAssetEditScope(doc) as editScope:
		editableAsset = editScope.Start(assetElem.Id)
		if (editableAsset.FindByName("BaseSchema")).Value == "GenericSchema":
			property = editableAsset.FindByName(Generic.GenericDiffuse)
		elif (editableAsset.FindByName("BaseSchema")).Value == "CeramicSchema":
			property = editableAsset.FindByName("ceramic_color")
		elif (editableAsset.FindByName("BaseSchema")).Value == "ConcreteSchema":
			property = editableAsset.FindByName("concrete_color")
		elif (editableAsset.FindByName("BaseSchema")).Value == "MetallicPaintSchema":
			property = editableAsset.FindByName("metallicpaint_base_color")
		elif (editableAsset.FindByName("BaseSchema")).Value == "MasonryCMUSchema":
			property = editableAsset.FindByName("masonrycmu_color")	
		elif (editableAsset.FindByName("BaseSchema")).Value == "PlasticVinylSchema":
			property = editableAsset.FindByName("plasticvinyl_color")
		elif (editableAsset.FindByName("BaseSchema")).Value == "HardwoodSchema":
			property = editableAsset.FindByName("hardwood_color")
		elif (editableAsset.FindByName("BaseSchema")).Value == "StoneSchema":
			property = editableAsset.FindByName("stone_color")	
		elif (editableAsset.FindByName("BaseSchema")).Value == "SolidGlassSchema":
			property = editableAsset.FindByName("solidglass_transmittance_custom_color")
		elif (editableAsset.FindByName("BaseSchema")).Value == "PrismLayeredSchema":
			property = editableAsset.FindByName("layered_diffuse")
		elif (editableAsset.FindByName("BaseSchema")).Value == "PrismMetalSchema":
			property = editableAsset.FindByName("surface_roughness")
		elif (editableAsset.FindByName("BaseSchema")).Value == "PrismOpaqueSchema":
			property = editableAsset.FindByName("opaque_albedo")
		elif (editableAsset.FindByName("BaseSchema")).Value == "PrismTransparentSchema":
			property = editableAsset.FindByName("surface_roughness")
		connectedAsset = property.GetSingleConnectedAsset()
		
		if path == None:
			pass
		else:	
			BitMapLocation = connectedAsset.FindByName(UnifiedBitmap.UnifiedbitmapBitmap) 
			if BitMapLocation.IsValidValue(path):
				#AssetProperty String Object
				BitMapLocation.Value = path
		if scaleWidht == None:
			pass
		else:		
			BitmapScaleX = connectedAsset.FindByName(UnifiedBitmap.TextureRealWorldScaleX)
			BitmapScaleX.Value = UnitUtils.ConvertToInternalUnits(scaleWidht, UIunit)
		if scaleHeight == None:
			pass
		else:
			BitmapScaleY = connectedAsset.FindByName(UnifiedBitmap.TextureRealWorldScaleY)
			BitmapScaleY.Value = UnitUtils.ConvertToInternalUnits(scaleHeight, UIunit)

		editScope.Commit(IFailuresPreprocessor)
	TransactionManager.Instance.TransactionTaskDone()

OUT = IN[0]
# ----------------------------------------
paint_surface_with_material = Python(IN[0]=getItemAtIndex, IN[1]=change_material_image_size)  # IronPython2
# ---------- paint_surface_with_material.python (46 lines) ----------
#Copyright(c) 2023, Cheng ZHANG

# Load the Python Standard and DesignScript Libraries
import sys
import clr
clr.AddReference('ProtoGeometry')
from Autodesk.DesignScript.Geometry import *

clr.AddReference('RevitAPI')
clr.AddReference('RevitServices')

import Autodesk
import RevitServices

from Autodesk.Revit.DB import *
from RevitServices.Persistence import DocumentManager
from RevitServices.Transactions import TransactionManager

doc =  DocumentManager.Instance.CurrentDBDocument

# The inputs to this node will be stored as a list in the IN variables.
surfaces = IN[0]
material = UnwrapElement(IN[1])

# Place your code below this line
def PaintFace(surf, mat):
	if not isinstance(surf, list):
		elemRef = surf.Tags.LookupTag('RevitFaceReference')
		elem = doc.GetElement(elemRef)
		face = elem.GetGeometryObjectFromReference(elemRef)
		if not (doc.IsPainted(elem.Id, face)):
			doc.Paint(elem.Id, face, mat.Id)
			return surf
	else:
		[PaintFace(i, mat) for i in surf]
		return surf
        

TransactionManager.Instance.EnsureInTransaction(doc)

OUT = PaintFace(surfaces, material)            

TransactionManager.Instance.TransactionTaskDone()

# Assign your output to the OUT variable.
OUT = 0
# ----------------------------------------
